# Grasshopper definition CaseE(Niigata).ghx (Grasshopper 1.0.8)
# plug-ins: Outdoor, Eddy3D-Outdoor+

panel = Panel("""0.005 
0.010 
0.020 
0.030 
0.050 
0.100 
0.200 
0.300 
0.400 
0.600 
0.800 
1.000 """)
panel_2 = Panel("""0.365 
0.390 
0.418 
0.437 
0.483 
0.559 
0.655 
0.730 
0.790 
0.893 
0.948 
1.000 """)
panel_3 = Panel("""0.008 
0.009 
0.009 
0.009 
0.010 
0.010 
0.009 
0.008 
0.007 
0.006 
0.004 
0.002 """)
series = Series(Start=0, Step="22.5", Count=Slider(16, range=0..100))
panel_4 = Panel(series)
inflow = ManualInflowProfile(
    NormalizedHeightZZR=panel,
    NormalizedVelocityUUR=panel_2,
    NormalizedTKEKUR2=panel_3,
    BoundaryLayerHeightZR=250,
    ReferenceVelocityUR=7.8,
    WindDirection=Vector(0, 1, 0),
    Cmu=0.09)
meshsettings = MeshSettings(
    RefinementBoxLevel=2,
    BuildingSurfaceLevel=2,
    BuildingFeatureLevel=2,
    GroundSurfaceLevel=2,
    LayerCount=4,
    AddLayers=False,
    Snap=True,
    GradingStrengthHorizontal=6,
    GradingStrengthVertical=6,
    AdaptiveGrading=True,
    WakeRefinement=3)
runsettings = RunSettings(Iterations=1000, WriteInterval=20, KeepTimeSteps=3, TurbulenceModel=1, CPUCount=1)  # -> RunSettings, DebugLogs
buildings = Mesh([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])

# ---- group: Newly Constructed
mesh = Mesh([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])

# ----
cyldomain = CylinderDomain(
    CoreCellSize=20,
    InnerCoreSize=-1,
    OuterRadius=600,
    Height="250",
    RadialMultiplier=2,
    CoreDivisions=1,
    RefinementBoxExtension=-1,
    RadialGrading=1.3,
    CoreRoundness=0.6)
merge = Merge(Data1=buildings, Data2=mesh)
path = FilePath("C:\Eddy3D-Cases\")

# ---- group: Terrain
srf = Surface(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)

# ----
panel_5 = Panel("""-27
-93
-88
-74
-61
-50.5
-33.5
-9.5
7
45
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""")
panel_6 = Panel("""112
33
35
40
45.5
49.5
57.5
69
76.5
94
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""")
windcase = WindCase(
    CaseName="AIJ_CASE_E",
    WorkingDirectory=path,
    BoundaryConditions=inflow,
    DomainParameters=cyldomain,
    Buildings=merge,
    Terrain=srf,
    MeshSettings=meshsettings,
    RunSettings=runsettings.RunSettings,
    WriteCase=Toggle(True),
    ClearCase=False,
    PreviewDimensions=True,
    PreviewGrid3D=False,
    PreviewGroundGrid=True,
    PreviewWindArrows=True)  # -> Logs, WriteLogs, Case, Domain, RefinementBox, Buildings
pt = ConstructPoint(XCoordinate=panel_5, YCoordinate=panel_6, ZCoordinate="2")
lng = ListLength(List=pt)
cir = Circle(Plane=pt, Radius=5)
series_2 = Series(Start=1, Step=1, Count=lng)
tag = TextTag(Location=pt, Text=series_2, Colour=RGB(0, 0, 0))
probe = Probe(Case=windcase.Case, Points=pt, Fields="U", ProbeName="ttt", Run=Toggle(True), CullInvalid=True, ShowRegion=False)  # -> Values, TimeSteps, SubResults
run = Run(
    Case=windcase.Case,
    Mesh=False,
    Simulate=False,
    RunAll=False,
    Parallel=False,
    Engine="BlueCFD",
    ShowDirection=False,
    ShowZones=False)
panel_7 = Panel(run)
branch = TreeBranch(Tree=probe.Values, Path=Slider(0, range=0..100), MaintainPaths=True)

# ---- group: Comparison for North direction
panel_8 = Panel(branch)
north_ground_truth = Panel("""0.18 
0.59 
0.38 
0.32 
0.30 
0.34 
0.26 
0.14 
0.12 
0.10 
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""")
